vi "Main.gvi"   [LabVIEW NXG 5.0.0]
# This template is for the Queued Message Handler design pattern.
# The Event Handling Loop generates messages based on user interface actions.
# The Message Handling Loop processes messages generated by the Event Handling Loop, or by other messages.  The messages are string values, so new messages can be added easily to the Message Cases case structure in the Message Handling Loop.  Each message cluster can also provide an optional value for Message Data, which is a variant that can be converted to whatever message-specific data is required.
panel controls:
  "Exit": bool
  "TEMP Button": bool
  "LUX Button": bool
  "VISA Resource Name": "VISA Instr" = "COM5"
  "Initialize VISA": bool
  "CMD Button": bool
  "Initialize AI": bool
  "PV Config Button": bool
  "Set PV Angle Button": bool
  "IR Thermometer Config Button": bool
  "Fans Button": bool
  "Brightness Config Button": bool
  "Optic Filter Config Button": bool
  "Reset CVM Button": bool
  "Stop": bool
  "PV Config Selector": string
  "PV Angle": i32
  "Fans Selector": string
  "Optic Filter Selector": string
  "IR Thermometer Selector": string
  "Brightness": i32
  "Prepare CVM Button": bool
  "write buffer": string = "@DO 34 0#"
  "stop_2": bool
  "Set Resistance Button": bool
  "Reset Resistance Button": bool
  "Resistance String": string
  "VAC Button": bool
panel indicators:
  "Display": string
  "TEMP_1": "TAG.gtype"
  "LUX_1": "TAG.gtype"
  "CMD": "TAG.gtype"
  "LUX_2": "TAG.gtype"
  "TEMP_2": "TAG.gtype"
  "Chart": waveform<f64>[]
  "Maсhine State": string
  "ANGLE Control": "TAG.gtype"
  "Thermometer Angle Control": "TAG.gtype"
  "Brightness Control": "TAG.gtype"
  "Image": "Vision IMAQImage"
  "Chart_2": waveform<f64>[]
  "Voltage Range": f64
  "error out": error
  "Variable: y": f64
  "Voltage coeff": f64
  "Current coeff": f64
  "V_real": f64
  "Current_real": f64
  "VAC Load Counter": i32
types:
  "TAG.gtype" = cluster{"Timestamp": timestamp, "DATA": string}
  "DataType.gtype" = enum{"Double", "I32", "String", "Boolean", "U64", "Timestamp"}
  "Tag.gtype" = cluster{"Path": string, "Datatype": "DataType.gtype", "Configuration": "Configuration.gtype"}
  "Client Handle.gtype" = u32
  "Configuration.gtype" = cluster{"Server URL": string, "Session": "Client Handle.gtype", "Raw Session Queue": Queue<"Client Handle.gtype">}
  T1 = cluster{"VISA Resource": "VISA Instr", "Physical Channel": "DAQmx Task", "tag": "Tag.gtype", "configuration": "Configuration.gtype"}
  "UI Data.gtype" = cluster{"Boolean <Replace Me>": bool, "String <Replace Me>": string, "Numeric <Replace Me>": f64}
  "ValueRange.gtype" = cluster{"maximum value": f64, "minimum value": f64}
uses:
  Message Queue::Create All Message Queues.gvi
  Message Queue::Dequeue Message.gvi
  Message Queue::Enqueue Message (Single).gvi
  NI::VISA::Configure Serial Port (Instr).gvi
  NI::VISA::Open (Instr).gvi
  NI::Skyline::Configuration::Open Configuration API Key.gvi
  NI::Skyline::TagHTTP::Open Tag.gvi
  NI::DAQmx::Internal::DAQmx Create Channel (AI-Voltage-Basic).gvi
  Queued Message Handler::Read_Write_VISA.gvi
  Queued Message Handler::PV_switch.gvi
  Queued Message Handler::CMD_Iteration.gvi
  NI::DAQmx::Internal::DAQmx Read (Analog 2D DBL NChan NSamp).gvi
  NI::Skyline::TagHTTP::Write Tag (String).gvi
  NI::DAQmx::Internal::DAQmx Read (Analog 1D Wfm NChan NSamp).gvi
  NI::G Core::Error::Display Error.gvi
  NI::VISA::Close (Instr).gvi
  NI::DAQmx::Internal::DAQmx Stop Task.gvi
  NI::Skyline::TagHTTP::Close Tag (Single).gvi
  NI::Skyline::Configuration::Close Configuration.gvi
  NI::G Core::Error::Build Error Cluster.gvi
  Support::Error Handler - Message Handling Loop.gvi
  Support::Error Handler - Event Handling Loop.gvi
  NI::Vision::IMAQdx::Initialize.gvi
  NI::Vision::IMAQdx::Configure Grab.gvi
  NI::Vision::Core::Basics::Create Image.gvi
  NI::Vision::IMAQdx::Grab.gvi
  NI::Vision::IMAQdx::Close.gvi
diagram:
  w1 = bool FALSE  # Stop Event
  Create User Event[EventName="Stop Event"](user event data type=w1) -> (error out=w2, user event out=w3)
  call "Create All Message Queues.gvi"(error in=w2) -> (message queues=w4, error out=w5)
  Property Node(instance in=w4) -> ("UI"=w6)
  w7 = T1 {"VISA Resource"="COM5", "Physical Channel"="", "tag"={"Path"="", "Datatype"="Double", "Configuration"={"Server URL"="", "Session"=0, "Raw Session Queue"=refnum}}, "configuration"={"Server URL"="", "Session"=0, "Raw Session Queue"=refnum}}
  s1 = "UI Data.gtype" {all zero or empty}  # shift register
  s2 = uninitialised  # shift register
  s3 = w7  # shift register
  while {
    call "Dequeue Message.gvi"(message queue in=w6, error in=w5) -> (message queue out=w8, message=w9, message data=w10, error out=w11)
    $"Maсhine State" <- w9
    # s1: Data
    # w3: Stop Event
    case (w9) ignore case {  # Message Cases
      frame "Initialize" {
        call "Enqueue Message (Single).gvi"(message queue in=w8, message="Initialize VISA", error in=w11) -> (error out=w17)
        call "Enqueue Message (Single).gvi"(message queue in=w8, message="Initialize AI", error in=w17) -> (error out=w18)
        call "Enqueue Message (Single).gvi"(message queue in=w8, message="Initialize SLC", error in=w18) -> (error out=w19)
        call "Enqueue Message (Single).gvi"(message queue in=w8, message="Wait For Event", error in=w19) -> (error out=w12)
        w13 = s1
        w14 = default
        w15 = s2
        w16 = s3
      }
      frame "Wait For Event" {
        call "Enqueue Message (Single).gvi"(message queue in=w8, message="Watchdog", error in=w11) -> (error out=w12)
        w13 = s1
        w14 = default
        w15 = s2
        w16 = s3
      }
      frame "Initialize VISA" {
        call "Configure Serial Port (Instr).gvi"(stop bits="1.0"(10), session in=$"VISA Resource Name", baud rate=115200, parity="None"(0), termination char=0xA, enable termination char=TRUE) -> (session out=w20, error out=w21)
        call "Open (Instr).gvi"(resource name=w20, error in=w21) -> (session out=w22, error out=w23)
        Property Node(instance in=s3, "VISA Resource"=w22) -> (instance out=w16)
        Wait(time to wait=2000)
        Merge Errors(w23, w11) -> (error out=w12)
        w13 = s1
        w14 = default
        w15 = s2
      }
      frame "Initialize SLC" {
        call "Open Configuration API Key.gvi"(server url="https://api.systemlinkcloud.com/", api key="zYUbuW0YNkg1G__lXfJiGVBNWME-HlVd2a5NUHp-IP") -> (configuration=w24, error out=w25)
        call "Open Tag.gvi"(path="PV_T", data type="String", error in=w25, configuration=w24) -> (tag=w26, error out=w27)
        Property Node(instance in=s3, "tag"=w26, "configuration"=w24) -> (instance out=w16)
        Wait(time to wait=2000)
        Merge Errors(w27, w11) -> (error out=w12)
        w13 = s1
        w14 = default
        w15 = s2
      }
      frame "Initialize AI" {
        call "DAQmx Create Channel (AI-Voltage-Basic).gvi"(physical channels="Dev1/ai0:1,Dev1/ai3,Dev1/ai7", units="Volts"(10348), measurement range="ValueRange.gtype" {"maximum value"=10, "minimum value"=0}, input terminal configuration="Default"(-1)) -> (task out=w28, error out=w29)
        Property Node(instance in=s3, "Physical Channel"=w28) -> (instance out=w16)
        Merge Errors(w29, w11) -> (error out=w12)
        w13 = s1
        w14 = default
        w15 = s2
      }
      frame "Send CMD" {
        Property Node(instance in=s3) -> ("VISA Resource"=w30, instance out=w16)
        call "Read_Write_VISA.gvi"(VISA_IN=w30, CMD=$"write buffer", ERROR_IN=w11) -> (TAG=w31, ERROR_OUT=w32)
        $CMD <- w31
        call "Enqueue Message (Single).gvi"(message queue in=w8, message="Wait For Event", error in=w11) -> (error out=w33)
        Merge Errors(w32, w33) -> (error out=w12)
        w13 = s1
        w14 = default
        w15 = $"write buffer"
      }
      frame "PV Config" {
        Variant To Data(error in (no error)=w11, type=string "", variant=w10) -> (data=w34, error out=w35)
        Property Node(instance in=s3) -> ("VISA Resource"=w36, instance out=w16)
        call "PV_switch.gvi"(VISA_IN=w36, CTRL="Disconnect", ERROR_IN=w35) -> (ERROR_OUT=w37)
        case (w34) {
          frame "Single", Default {
            # @DO 17 0#
            # @DO 18 1#
            # @DO 23 1#
            # @DO 24 1#
            # @DO 25 1#
            # @DO 26 0#
            # @DO 27 0#
            # @DO 28 0#
            # @DO 29 1#
            # @DO 30 1#
            # @DO 31 1#
            # @DO 32 1#
            # @DO 33 0#
            #
            # 03,08,2020
            # 19:51
            w39 = ["@DO 17 0#", "@DO 18 1#", "@DO 23 1#", "@DO 24 1#", "@DO 25 1#", "@DO 26 0#", "@DO 27 0#", "@DO 28 0#", "@DO 29 1#", "@DO 30 1#", "@DO 31 1#", "@DO 32 1#", "@DO 33 0#"]
            w40 = ["@DO 54 1#", "@DO 55 1#", "@DO 56 1#", "@DO 57 1#", "@DO 58 1#", "@DO 59 1#", "@DO 60 1#", "@DO 61 1#"]
            Insert Into Array(inArray=w39, new=w40) -> w41
            call "CMD_Iteration.gvi"(VISA_IN=w36, ARRAY_IN=w41, ERROR_IN=w37) -> (ERROR_OUT=w38)
          }
          frame "Parallel 2" {
            # @DO 17 1#
            # @DO 18 0#
            # @DO 23 1#
            # @DO 24 0#
            # @DO 25 1#
            # @DO 26 1#
            # @DO 27 1#
            # @DO 28 1#
            # @DO 29 1#
            # @DO 30 1#
            # @DO 31 1#
            # @DO 32 1#
            # @DO 33 1#
            #
            # 03.08.2020
            # 19.53
            w42 = ["@DO 17 1#", "@DO 18 0#", "@DO 23 1#", "@DO 24 0#", "@DO 25 1#", "@DO 26 1#", "@DO 27 1#", "@DO 28 1#", "@DO 29 1#", "@DO 30 1#", "@DO 31 1#", "@DO 32 1#", "@DO 33 1#"]
            # Disconnect all Diodes
            w43 = ["@DO 54 1#", "@DO 55 1#", "@DO 56 1#", "@DO 57 1#", "@DO 58 1#", "@DO 59 1#", "@DO 60 1#", "@DO 61 1#"]
            Insert Into Array(inArray=w42, new=w43) -> w44
            call "CMD_Iteration.gvi"(VISA_IN=w36, ARRAY_IN=w44, ERROR_IN=w37) -> (ERROR_OUT=w38)
          }
          frame "Parallel 2 Diode" {
            # @DO 17 1#
            # @DO 18 0#
            # @DO 23 1#
            # @DO 24 0#
            # @DO 25 1#
            # @DO 26 1#
            # @DO 27 1#
            # @DO 28 1#
            # @DO 29 1#
            # @DO 30 1#
            # @DO 31 1#
            # @DO 32 1#
            # @DO 33 1#
            #
            # 03.08.2020
            # 19.54
            w45 = ["@DO 17 1#", "@DO 18 0#", "@DO 23 1#", "@DO 24 0#", "@DO 25 1#", "@DO 26 1#", "@DO 27 1#", "@DO 28 1#", "@DO 29 1#", "@DO 30 1#", "@DO 31 1#", "@DO 32 1#", "@DO 33 1#"]
            # @DO 56 0#
            # @DO 57 0#
            #
            # 19.54
            w46 = ["@DO 54 1#", "@DO 55 1#", "@DO 56 0#", "@DO 57 0#", "@DO 58 1#", "@DO 59 1#", "@DO 60 1#", "@DO 61 1#"]
            Insert Into Array(inArray=w45, new=w46) -> w47
            call "CMD_Iteration.gvi"(VISA_IN=w36, ARRAY_IN=w47, ERROR_IN=w37) -> (ERROR_OUT=w38)
          }
          frame "Series 2" {
            # @DO 17 0#
            # @DO 18 1#
            # @DO 23 1#
            # @DO 24 0#
            # @DO 25 1#
            # @DO 26 1#
            # @DO 27 1#
            # @DO 28 1#
            # @DO 29 0#
            # @DO 30 1#
            # @DO 31 1#
            # @DO 32 0#
            # @DO 33 0#
            #
            # 03.08.2020
            # 19.55
            w48 = ["@DO 17 0#", "@DO 18 1#", "@DO 23 1#", "@DO 24 0#", "@DO 25 1#", "@DO 26 1#", "@DO 27 1#", "@DO 28 1#", "@DO 29 0#", "@DO 30 1#", "@DO 31 1#", "@DO 32 0#", "@DO 33 0#"]
            w49 = ["@DO 54 1#", "@DO 55 1#", "@DO 56 1#", "@DO 57 1#", "@DO 58 1#", "@DO 59 1#", "@DO 60 1#", "@DO 61 1#"]
            Insert Into Array(inArray=w48, new=w49) -> w50
            call "CMD_Iteration.gvi"(VISA_IN=w36, ARRAY_IN=w50, ERROR_IN=w37) -> (ERROR_OUT=w38)
          }
          frame "Series 2 Diode" {
            # @DO 17 0#
            # @DO 18 1#
            # @DO 23 1#
            # @DO 24 0#
            # @DO 25 1#
            # @DO 26 1#
            # @DO 27 1#
            # @DO 28 1#
            # @DO 29 0#
            # @DO 30 1#
            # @DO 31 1#
            # @DO 32 0#
            # @DO 33 0#
            #
            # 03.08.2020
            # 19.57
            w51 = ["@DO 17 0#", "@DO 18 1#", "@DO 23 1#", "@DO 24 0#", "@DO 25 1#", "@DO 26 1#", "@DO 27 1#", "@DO 28 1#", "@DO 29 0#", "@DO 30 1#", "@DO 31 1#", "@DO 32 0#", "@DO 33 0#"]
            # @DO 60 0#
            # @DO 61 0#
            #
            # 03.08.2020
            w52 = ["@DO 54 1#", "@DO 55 1#", "@DO 56 1#", "@DO 57 1#", "@DO 58 1#", "@DO 59 1#", "@DO 60 0#", "@DO 61 0#"]
            Insert Into Array(inArray=w51, new=w52) -> w53
            call "CMD_Iteration.gvi"(VISA_IN=w36, ARRAY_IN=w53, ERROR_IN=w37) -> (ERROR_OUT=w38)
          }
          frame "Parallel 4" {
            # @DO 17 1#
            # @DO 18 1#
            # @DO 23 1#
            # @DO 24 1#
            # @DO 25 1#
            # @DO 26 1#
            # @DO 27 1#
            # @DO 28 1#
            # @DO 29 1#
            # @DO 30 1#
            # @DO 31 1#
            # @DO 32 1#
            # @DO 33 1#
            #
            # 03.08.2020
            # 19.59
            w54 = ["@DO 17 1#", "@DO 18 1#", "@DO 23 1#", "@DO 24 1#", "@DO 25 1#", "@DO 26 1#", "@DO 27 1#", "@DO 28 1#", "@DO 29 1#", "@DO 30 1#", "@DO 31 1#", "@DO 32 1#", "@DO 33 1#"]
            w55 = ["@DO 54 1#", "@DO 55 1#", "@DO 56 1#", "@DO 57 1#", "@DO 58 1#", "@DO 59 1#", "@DO 60 1#", "@DO 61 1#"]
            Insert Into Array(inArray=w54, new=w55) -> w56
            call "CMD_Iteration.gvi"(VISA_IN=w36, ARRAY_IN=w56, ERROR_IN=w37) -> (ERROR_OUT=w38)
          }
          frame "Parallel 4 Diode" {
            # @DO 17 1#
            # @DO 18 1#
            # @DO 23 1#
            # @DO 24 1#
            # @DO 25 1#
            # @DO 26 1#
            # @DO 27 1#
            # @DO 28 1#
            # @DO 29 1#
            # @DO 30 1#
            # @DO 31 1#
            # @DO 32 1#
            # @DO 33 1#
            # 03.08.2020
            # 20.00
            w57 = ["@DO 17 1#", "@DO 18 1#", "@DO 23 1#", "@DO 24 1#", "@DO 25 1#", "@DO 26 1#", "@DO 27 1#", "@DO 28 1#", "@DO 29 1#", "@DO 30 1#", "@DO 31 1#", "@DO 32 1#", "@DO 33 1#"]
            # @DO 54 0#
            # @DO 55 0#
            # @DO 56 0#
            # @DO 57 0#
            #
            # 03.08.2020
            # 20.00
            w58 = ["@DO 54 0#", "@DO 55 0#", "@DO 56 0#", "@DO 57 0#", "@DO 58 1#", "@DO 59 1#", "@DO 60 1#", "@DO 61 1#"]
            Insert Into Array(inArray=w57, new=w58) -> w59
            call "CMD_Iteration.gvi"(VISA_IN=w36, ARRAY_IN=w59, ERROR_IN=w37) -> (ERROR_OUT=w38)
          }
          frame "Series 4" {
            w60 = ["@DO 54 1#", "@DO 55 1#", "@DO 56 1#", "@DO 57 1#", "@DO 58 1#", "@DO 59 1#", "@DO 60 1#", "@DO 61 1#"]
            # @DO 17 0#
            # @DO 18 1#
            # @DO 23 0#
            # @DO 24 1#
            # @DO 25 1#
            # @DO 26 0#
            # @DO 27 0#
            # @DO 28 0#
            # @DO 29 0#
            # @DO 30 0#
            # @DO 31 0#
            # @DO 32 0#
            # @DO 33 0#
            #
            # 03.08.2020
            # 20.02
            w61 = ["@DO 17 0#\n", "@DO 18 1#", "@DO 23 0#", "@DO 24 1#", "@DO 25 1#", "@DO 26 0#", "@DO 27 0#", "@DO 28 0#", "@DO 29 0#", "@DO 30 0#", "@DO 31 0#", "@DO 32 0#", "@DO 33 0#"]
            Insert Into Array(inArray=w61, new=w60) -> w62
            call "CMD_Iteration.gvi"(VISA_IN=w36, ARRAY_IN=w62, ERROR_IN=w37) -> (ERROR_OUT=w38)
          }
          frame "Series 4 Diode" {
            # @DO 17 0#
            # @DO 18 1#
            # @DO 23 0#
            # @DO 24 1#
            # @DO 25 1#
            # @DO 26 0#
            # @DO 27 0#
            # @DO 28 0#
            # @DO 29 0#
            # @DO 30 0#
            # @DO 31 0#
            # @DO 32 0#
            # @DO 33 0#
            #
            # 03.08.2020
            # 20.03
            w63 = ["@DO 17 0#\n", "@DO 18 1#", "@DO 23 0#", "@DO 24 1#", "@DO 25 1#", "@DO 26 0#", "@DO 27 0#", "@DO 28 0#", "@DO 29 0#", "@DO 30 0#", "@DO 31 0#", "@DO 32 0#", "@DO 33 0#"]
            # @DO 58 0#
            # @DO 59 0#
            # @DO 60 0#
            # @DO 61 0#
            #
            # 03.08.2020
            # 20.04
            w64 = ["@DO 54 1#", "@DO 55 1#", "@DO 56 1#", "@DO 57 1#", "@DO 58 0#", "@DO 59 0#", "@DO 60 0#", "@DO 61 0#"]
            Insert Into Array(inArray=w63, new=w64) -> w65
            call "CMD_Iteration.gvi"(VISA_IN=w36, ARRAY_IN=w65, ERROR_IN=w37) -> (ERROR_OUT=w38)
          }
          frame "Parallel Of Series" {
            # @DO 17 1#
            # @DO 18 1#
            # @DO 23 1#
            # @DO 24 1#
            # @DO 25 1#
            # @DO 26 1#
            # @DO 27 0#
            # @DO 28 1#
            # @DO 29 0#
            # @DO 30 0#
            # @DO 31 1#
            # @DO 32 0#
            # @DO 33 1#
            #
            # 03.08.2020
            # 20.05
            w66 = ["@DO 17 1#", "@DO 18 1#", "@DO 23 1#", "@DO 24 1#", "@DO 25 1#", "@DO 26 1#", "@DO 27 0#", "@DO 28 1#", "@DO 29 0#", "@DO 30 0#", "@DO 31 1#", "@DO 32 0#", "@DO 33 1#"]
            w67 = ["@DO 54 1#", "@DO 55 1#", "@DO 56 1#", "@DO 57 1#", "@DO 58 1#", "@DO 59 1#", "@DO 60 1#", "@DO 61 1#"]
            Insert Into Array(inArray=w66, new=w67) -> w68
            call "CMD_Iteration.gvi"(VISA_IN=w36, ARRAY_IN=w68, ERROR_IN=w37) -> (ERROR_OUT=w38)
          }
          frame "Parallel Of Series Diode" {
            # @DO 17 1#
            # @DO 18 1#
            # @DO 23 1#
            # @DO 24 1#
            # @DO 25 1#
            # @DO 26 1#
            # @DO 27 0#
            # @DO 28 1#
            # @DO 29 0#
            # @DO 30 0#
            # @DO 31 1#
            # @DO 32 0#
            # @DO 33 1#
            #
            # 03.08.2020
            # 20.06
            # @DO 58 0#
            # @DO 59 0#
            # @DO 60 0#
            # @DO 61 0#
            #
            # 03.08.2020
            # 20.097
            w69 = ["@DO 17 1#", "@DO 18 1#", "@DO 23 1#", "@DO 24 1#", "@DO 25 1#", "@DO 26 1#", "@DO 27 0#", "@DO 28 1#", "@DO 29 0#", "@DO 30 0#", "@DO 31 1#", "@DO 32 0#", "@DO 33 1#"]
            w70 = ["@DO 54 1#", "@DO 55 1#", "@DO 56 1#", "@DO 57 1#", "@DO 58 0#", "@DO 59 0#", "@DO 60 0#", "@DO 61 0#"]
            Insert Into Array(inArray=w69, new=w70) -> w71
            call "CMD_Iteration.gvi"(VISA_IN=w36, ARRAY_IN=w71, ERROR_IN=w37) -> (ERROR_OUT=w38)
          }
          frame "Series Of Parallel" {
            w72 = ["@DO 54 1#", "@DO 55 1#", "@DO 56 1#", "@DO 57 1#", "@DO 58 1#", "@DO 59 1#", "@DO 60 1#", "@DO 61 1#"]
            # @DO 17 1#
            # @DO 18 0#
            # @DO 23 0#
            # @DO 24 0#
            # @DO 25 0#
            # @DO 26 1#
            # @DO 27 1#
            # @DO 28 1#
            # @DO 29 1#
            # @DO 30 1#
            # @DO 31 1#
            # @DO 32 1#
            # @DO 33 1#
            #
            # 03.08.2020
            # 20.07
            w73 = ["@DO 17 1#", "@DO 18 0#", "@DO 23 0#", "@DO 24 0#", "@DO 25 0#", "@DO 26 1#", "@DO 27 1#", "@DO 28 1#", "@DO 29 1#", "@DO 30 1#", "@DO 31 1#", "@DO 32 1#", "@DO 33 1#"]
            Insert Into Array(inArray=w73, new=w72) -> w74
            call "CMD_Iteration.gvi"(VISA_IN=w36, ARRAY_IN=w74, ERROR_IN=w37) -> (ERROR_OUT=w38)
          }
          frame "Series Of Parallel Diode" {
            # @DO 17 1#
            # @DO 18 0#
            # @DO 23 0#
            # @DO 24 0#
            # @DO 25 0#
            # @DO 26 1#
            # @DO 27 1#
            # @DO 28 1#
            # @DO 29 1#
            # @DO 30 1#
            # @DO 31 1#
            # @DO 32 1#
            # @DO 33 1#
            #
            # 03.08.2020
            # 20.08
            w75 = ["@DO 17 1#", "@DO 18 0#", "@DO 23 0#", "@DO 24 0#", "@DO 25 0#", "@DO 26 1#", "@DO 27 1#", "@DO 28 1#", "@DO 29 1#", "@DO 30 1#", "@DO 31 1#", "@DO 32 1#", "@DO 33 1#"]
            # @DO 54 0#
            # @DO 55 0#
            # @DO 56 0#
            # @DO 57 0#
            #
            # 20.09
            # 03.08.2020
            w76 = ["@DO 54 0#", "@DO 55 0#", "@DO 56 0#", "@DO 57 0#", "@DO 58 1#", "@DO 59 1#", "@DO 60 1#", "@DO 61 1#"]
            Insert Into Array(inArray=w75, new=w76) -> w77
            call "CMD_Iteration.gvi"(VISA_IN=w36, ARRAY_IN=w77, ERROR_IN=w37) -> (ERROR_OUT=w38)
          }
        }
        call "PV_switch.gvi"(VISA_IN=w36, CTRL="Connect", ERROR_IN=w38) -> (ERROR_OUT=w12)
        w13 = s1
        w14 = default
        w15 = s2
      }
      frame "Reset CVM" {
        Property Node(instance in=s3) -> ("VISA Resource"=w78, instance out=w16)
        # VOLTAGE RANGE
        # @DO 51 0#
        # @DO 52 0#
        # @DO 53 0#
        call "CMD_Iteration.gvi"(VISA_IN=w78, ARRAY_IN=["@DO 51 1#", "@DO 52 1#", "@DO 53 1#"], ERROR_IN=w11) -> (ERROR_OUT=w79)
        # CURRENT RANGE
        # @DO 50 1#
        call "CMD_Iteration.gvi"(VISA_IN=w78, ARRAY_IN=["@DO 50 1#"], ERROR_IN=w79) -> (ERROR_OUT=w12)
        $"Voltage coeff" <- 0.25
        $"Current coeff" <- 1
        w13 = s1
        w14 = default
        w15 = s2
      }
      frame "VAC" {
        w80 = ["1", "2", "3", "10", "20", "40", "100", "200", "1000", "2000", "4000"]
        Array Size(array=w80) -> (size(s)=w81)
        Is Less Or Equal(x=$"VAC Load Counter", y=w81) -> w82
        Variant To Data(type=timestamp 1904-01-01T00:00:00Z, variant=w10) -> (data=w83)
        Get Current Time() -> (current time=w84)
        Timestamp Subtract(x=w84, y=w83) -> w85
        Is Greater Or Equal(x=w85, y=10) -> w86
        Logical And(w86, w82) -> w87
        Property Node(instance in=s3) -> ("VISA Resource"=w88, instance out=w16)
        case (w87) {
          frame False, Default {
            w89 = w11
            w90 = w83
            w91 = $"VAC Load Counter"
          }
          frame True {
            Get Current Time() -> (current time=w90)
            Array Index(array=w80) -> (out0[$"VAC Load Counter"]=w92)
            # Disconnect ALL load
            w93 = ["@DO 42 1#", "@DO 34 1#", "@DO 35 1#", "@DO 36 1#", "@DO 37 1#", "@DO 38 1#", "@DO 39 1#", "@DO 40 1#", "@DO 41 1#", "@DO 43 1#", "@DO 44 1#", "@DO 45 1#", "@DO 46 1#", "@DO 47 1#", "@DO 48 1#", "@DO 49 1#"]
            call "CMD_Iteration.gvi"(VISA_IN=w88, ARRAY_IN=w93, ERROR_IN=w11) -> (ERROR_OUT=w94)
            s4 = w92  # shift register
            while {
              Match Pattern(regular expression=",", string=s4) -> (after substring=w95, before substring=w96)
              case (w96) {
                frame "1" {
                  call "Read_Write_VISA.gvi"(VISA_IN=w88, CMD="@DO 43 0#", ERROR_IN=w94) -> (ERROR_OUT=w97)
                }
                frame "2" {
                  call "Read_Write_VISA.gvi"(VISA_IN=w88, CMD="@DO 44 0#", ERROR_IN=w94) -> (ERROR_OUT=w97)
                }
                frame "3" {
                  call "Read_Write_VISA.gvi"(VISA_IN=w88, CMD="@DO 45 0#", ERROR_IN=w94) -> (ERROR_OUT=w97)
                }
                frame "5" {
                  call "Read_Write_VISA.gvi"(VISA_IN=w88, CMD="@DO 46 0#", ERROR_IN=w94) -> (ERROR_OUT=w97)
                }
                frame "10" {
                  call "Read_Write_VISA.gvi"(VISA_IN=w88, CMD="@DO 47 0#", ERROR_IN=w94) -> (ERROR_OUT=w97)
                }
                frame "20" {
                  call "Read_Write_VISA.gvi"(VISA_IN=w88, CMD="@DO 48 0#", ERROR_IN=w94) -> (ERROR_OUT=w97)
                }
                frame "40" {
                  call "Read_Write_VISA.gvi"(VISA_IN=w88, CMD="@DO 49 0#", ERROR_IN=w94) -> (ERROR_OUT=w97)
                }
                frame "50" {
                  call "Read_Write_VISA.gvi"(VISA_IN=w88, CMD="@DO 41 0#", ERROR_IN=w94) -> (ERROR_OUT=w97)
                }
                frame "100" {
                  call "Read_Write_VISA.gvi"(VISA_IN=w88, CMD="@DO 34 0#", ERROR_IN=w94) -> (ERROR_OUT=w97)
                }
                frame "200" {
                  call "Read_Write_VISA.gvi"(VISA_IN=w88, CMD="@DO 35 0#", ERROR_IN=w94) -> (ERROR_OUT=w97)
                }
                frame "400" {
                  call "Read_Write_VISA.gvi"(VISA_IN=w88, CMD="@DO 36 0#", ERROR_IN=w94) -> (ERROR_OUT=w97)
                }
                frame "500" {
                  call "Read_Write_VISA.gvi"(VISA_IN=w88, CMD="@DO 37 0#", ERROR_IN=w94) -> (ERROR_OUT=w97)
                }
                frame "1000" {
                  call "Read_Write_VISA.gvi"(VISA_IN=w88, CMD="@DO 38 0#", ERROR_IN=w94) -> (ERROR_OUT=w97)
                }
                frame "2000" {
                  call "Read_Write_VISA.gvi"(VISA_IN=w88, CMD="@DO 39 0#", ERROR_IN=w94) -> (ERROR_OUT=w97)
                }
                frame "4000", Default {
                  call "Read_Write_VISA.gvi"(VISA_IN=w88, CMD="@DO 40 0#", ERROR_IN=w94) -> (ERROR_OUT=w97)
                }
              }
              Is Empty String Or Path(string/path=w95) -> w98
              next s4 = w95
              stop if w98
            }
            call "Read_Write_VISA.gvi"(VISA_IN=w88, CMD="@DO 42 0#", ERROR_IN=w97) -> (ERROR_OUT=w89)
            Increment(x=$"VAC Load Counter") -> w91
          }
        }
        call "Enqueue Message (Single).gvi"(message queue in=w8, message="Watchdog", error in=w89) -> (error out=w99)
        case (w82) {
          frame False, Default {
            w12 = w99
          }
          frame True {
            call "Enqueue Message (Single).gvi"(message queue in=w8, message="VAC", message data=w90, error in=w99) -> (error out=w12)
          }
        }
        $"VAC Load Counter" <- w91
        w13 = s1
        w14 = default
        w15 = s2
      }
      frame "Prepare CVM" {
        Property Node(instance in=s3) -> ("VISA Resource"=w100, "Physical Channel"=w101, instance out=w16)
        call "DAQmx Read (Analog 2D DBL NChan NSamp).gvi"(task in=w101, error in=w11, number of samples per channel=1) -> (data=w102)
        Array Index(array=w102) -> (out0[2, 0]=w103)
        Multiply(w103, 4) -> w104
        C Code Node("x"=w104) -> ("y"=w105, Error Out=w106)
        ~~~
        if(x>-1 && x<=1)
          y = 0;
        if(x>1 && x<=10)
          y = 1;
        if(x>10 && x<=20)
          y = 2;
        if(x>20 && x<=30)
          y = 3;
        ~~~
        $"Voltage Range" <- w105
        # Voltage Range
        # Tip For Local Wiring Solution
        # Relay 1(50) 	DO 1- REP A x1
        # 		DO 0- AMP A x10
        #
        # Relay 2(51) 	DO 1-REP V x1
        # 		DO 0-DIV V x0.25
        # Relay 3(52) 	DO 1-REP V x1
        # 		DO 0-DIV V x0.5
        # Relay 4(53) 	DO 1-REP V x1
        # 		DO 0-AMP V x10
        case (w105) {
          frame 0, Default {
            call "CMD_Iteration.gvi"(VISA_IN=w100, ARRAY_IN=["@DO 51 1#\n", "@DO 52 1#", "@DO 53 0#"], ERROR_IN=w106) -> (ERROR_OUT=w107)
            w108 = 0.1
          }
          frame 1 {
            call "CMD_Iteration.gvi"(VISA_IN=w100, ARRAY_IN=["@DO 51 1#\n", "@DO 52 1#", "@DO 53 1#"], ERROR_IN=w106) -> (ERROR_OUT=w107)
            w108 = 1
          }
          frame 2 {
            call "CMD_Iteration.gvi"(VISA_IN=w100, ARRAY_IN=["@DO 51 1#\n", "@DO 52 0#", "@DO 53 1#"], ERROR_IN=w106) -> (ERROR_OUT=w107)
            w108 = 2
          }
          frame 3 {
            # Div x0.25 works with 2 relay
            call "CMD_Iteration.gvi"(VISA_IN=w100, ARRAY_IN=["@DO 51 0#\n", "@DO 52 0#", "@DO 53 1#"], ERROR_IN=w106) -> (ERROR_OUT=w107)
            w108 = 4
          }
        }
        $"Voltage coeff" <- w108
        Array Index(array=w102) -> (out0[6, 0]=w109)
        C Code Node("x"=w109) -> ("y"=w110)
        ~~~
        if(x>-1 && x<=0.6)
          y = 0;
        if(x>0.6 && x<=6)
          y = 1;
        ~~~
        # Current Range
        case (w110) {
          frame 0, Default {
            call "CMD_Iteration.gvi"(VISA_IN=w100, ARRAY_IN=["@DO 50 0#"], ERROR_IN=w107) -> (ERROR_OUT=w12)
            w111 = 0.1
          }
          frame 1 {
            call "CMD_Iteration.gvi"(VISA_IN=w100, ARRAY_IN=["@DO 50 1#"], ERROR_IN=w107) -> (ERROR_OUT=w12)
            w111 = 0.1
          }
        }
        $"Current coeff" <- w111
        $"Variable: y" <- w110
        w13 = s1
        w14 = default
        w15 = s2
      }
      frame "Fans Control" {
        Variant To Data(error in (no error)=w11, type=string "", variant=w10) -> (data=w112, error out=w113)
        case (w112) {
          frame "Turn All Off", Default {
            w114 = ["@DO 7 1#", "@DO 8 1#"]
          }
          frame "Turn All On" {
            w114 = ["@DO 7 0#", "@DO 8 0#"]
          }
          frame "Turn 1,2 On" {
            w114 = ["@DO 7 1#", "@DO 8 0#", ""]
          }
          frame "Turn 3,4 On" {
            w114 = ["@DO 8 1#", "@DO 7 0#"]
          }
        }
        Property Node(instance in=s3) -> ("VISA Resource"=w115, instance out=w16)
        call "CMD_Iteration.gvi"(VISA_IN=w115, ARRAY_IN=w114, ERROR_IN=w113) -> (ERROR_OUT=w12)
        w13 = s1
        w14 = default
        w15 = s2
      }
      frame "Optic Filter Config" {
        Variant To Data(error in (no error)=w11, type=string "", variant=w10) -> (data=w116, error out=w117)
        case (w116) {
          frame "None", Default {
            w118 = ["@SERV 3 90#", "@SERV 4 0#"]
          }
          frame "Filter 1" {
            w118 = ["@SERV 3 90#", "@SERV 4 0#", "@SERV 3 0#"]
          }
          frame "Filter 2" {
            w118 = ["@SERV 3 90#", "@SERV 4 0#", "@SERV 4 90#"]
          }
        }
        Property Node(instance in=s3) -> ("VISA Resource"=w119, instance out=w16)
        call "CMD_Iteration.gvi"(VISA_IN=w119, ARRAY_IN=w118, ERROR_IN=w117) -> (ERROR_OUT=w12)
        w13 = s1
        w14 = default
        w15 = s2
      }
      frame "Set PV Angle" {
        Variant To Data(error in (no error)=w11, type=u32 0, variant=w10) -> (data=w120, error out=w121)
        Property Node(instance in=s3) -> ("VISA Resource"=w122, instance out=w16)
        # Set angle limits for PV panels
        In Range And Coerce(lower limit=0, upper limit=180, x=w120) -> (coerced(x)=w123)
        Number To Decimal String(number=w123) -> (decimal integer string=w124)
        Concatenate Strings("@SERV 13 ", w124, " #") -> w125
        call "Read_Write_VISA.gvi"(VISA_IN=w122, CMD=w125, ERROR_IN=w121) -> (TAG=w126, ERROR_OUT=w12)
        $"ANGLE Control" <- w126
        w13 = s1
        w14 = default
        w15 = s2
      }
      frame "Brightness Config" {
        Variant To Data(error in (no error)=w11, type=u32 0, variant=w10) -> (data=w127, error out=w128)
        Property Node(instance in=s3) -> ("VISA Resource"=w129, instance out=w16)
        # Set brightness limits
        In Range And Coerce(lower limit=0, upper limit=100, x=w127) -> (coerced(x)=w130)
        Number To Decimal String(number=w130) -> (decimal integer string=w131)
        Concatenate Strings("@DIM 6 ", w131, " #") -> w132
        call "Read_Write_VISA.gvi"(VISA_IN=w129, CMD=w132, ERROR_IN=w128) -> (TAG=w133, ERROR_OUT=w12)
        $"Brightness Control" <- w133
        w13 = s1
        w14 = default
        w15 = s2
      }
      frame "IR Thermometer" {
        Variant To Data(error in (no error)=w11, type=string "", variant=w10) -> (data=w134, error out=w135)
        case (w134) {
          frame "None", Default {
            w136 = "@SERV 5 0#"
          }
          frame "Panel 1" {
            w136 = "@SERV 5 50#"
          }
          frame "Panel 2" {
            w136 = "@SERV 5 90#"
          }
          frame "Panel 3" {
            w136 = "@SERV 5 120#"
          }
          frame "Panel 4" {
            w136 = "@SERV 5 150#"
          }
        }
        Property Node(instance in=s3) -> ("VISA Resource"=w137, instance out=w16)
        call "Read_Write_VISA.gvi"(VISA_IN=w137, CMD=w136, ERROR_IN=w135) -> (TAG=w138, ERROR_OUT=w12)
        $"Thermometer Angle Control" <- w138
        w13 = s1
        w14 = default
        w15 = s2
      }
      frame "Get Temperature" {
        Property Node(instance in=s3) -> ("VISA Resource"=w139, instance out=w16)
        call "Read_Write_VISA.gvi"(VISA_IN=w139, CMD="@TEMP 12 0#", ERROR_IN=w11) -> (TAG=w140, ERROR_OUT=w141)
        $TEMP_1 <- w140
        call "Enqueue Message (Single).gvi"(message queue in=w8, message="Wait For Event", error in=w11) -> (error out=w142)
        Merge Errors(w141, w142) -> (error out=w12)
        w13 = s1
        w14 = default
        w15 = s2
      }
      frame "Get Brightness" {
        Property Node(instance in=s3) -> ("VISA Resource"=w143, instance out=w16)
        call "Read_Write_VISA.gvi"(VISA_IN=w143, CMD="@LUX 10 1#", ERROR_IN=w11) -> (TAG=w144, ERROR_OUT=w145)
        $LUX_1 <- w144
        call "Enqueue Message (Single).gvi"(message queue in=w8, message="Wait For Event", error in=w11) -> (error out=w146)
        Merge Errors(w145, w146) -> (error out=w12)
        w13 = s1
        w14 = default
        w15 = s2
      }
      frame "Set Resistance" {
        Property Node(instance in=s3) -> ("VISA Resource"=w147, instance out=w16)
        Variant To Data(error in (no error)=w11, type=string "", variant=w10) -> (data=w148, error out=w149)
        # Disconnect ALL load
        w150 = ["@DO 42 1#", "@DO 34 1#", "@DO 35 1#", "@DO 36 1#", "@DO 37 1#", "@DO 38 1#", "@DO 39 1#", "@DO 40 1#", "@DO 41 1#", "@DO 43 1#", "@DO 44 1#", "@DO 45 1#", "@DO 46 1#", "@DO 47 1#", "@DO 48 1#", "@DO 49 1#"]
        call "CMD_Iteration.gvi"(VISA_IN=w147, ARRAY_IN=w150, ERROR_IN=w149) -> (ERROR_OUT=w151)
        s5 = w148  # shift register
        while {
          Match Pattern(regular expression=",", string=s5) -> (after substring=w152, before substring=w153)
          case (w153) {
            frame "1" {
              call "Read_Write_VISA.gvi"(VISA_IN=w147, CMD="@DO 43 0#", ERROR_IN=w151) -> (ERROR_OUT=w154)
            }
            frame "2" {
              call "Read_Write_VISA.gvi"(VISA_IN=w147, CMD="@DO 44 0#", ERROR_IN=w151) -> (ERROR_OUT=w154)
            }
            frame "3" {
              call "Read_Write_VISA.gvi"(VISA_IN=w147, CMD="@DO 45 0#", ERROR_IN=w151) -> (ERROR_OUT=w154)
            }
            frame "5" {
              call "Read_Write_VISA.gvi"(VISA_IN=w147, CMD="@DO 46 0#", ERROR_IN=w151) -> (ERROR_OUT=w154)
            }
            frame "10" {
              call "Read_Write_VISA.gvi"(VISA_IN=w147, CMD="@DO 47 0#", ERROR_IN=w151) -> (ERROR_OUT=w154)
            }
            frame "20" {
              call "Read_Write_VISA.gvi"(VISA_IN=w147, CMD="@DO 48 0#", ERROR_IN=w151) -> (ERROR_OUT=w154)
            }
            frame "40" {
              call "Read_Write_VISA.gvi"(VISA_IN=w147, CMD="@DO 49 0#", ERROR_IN=w151) -> (ERROR_OUT=w154)
            }
            frame "50" {
              call "Read_Write_VISA.gvi"(VISA_IN=w147, CMD="@DO 41 0#", ERROR_IN=w151) -> (ERROR_OUT=w154)
            }
            frame "100" {
              call "Read_Write_VISA.gvi"(VISA_IN=w147, CMD="@DO 34 0#", ERROR_IN=w151) -> (ERROR_OUT=w154)
            }
            frame "200" {
              call "Read_Write_VISA.gvi"(VISA_IN=w147, CMD="@DO 35 0#", ERROR_IN=w151) -> (ERROR_OUT=w154)
            }
            frame "400" {
              call "Read_Write_VISA.gvi"(VISA_IN=w147, CMD="@DO 36 0#", ERROR_IN=w151) -> (ERROR_OUT=w154)
            }
            frame "500" {
              call "Read_Write_VISA.gvi"(VISA_IN=w147, CMD="@DO 37 0#", ERROR_IN=w151) -> (ERROR_OUT=w154)
            }
            frame "1000" {
              call "Read_Write_VISA.gvi"(VISA_IN=w147, CMD="@DO 38 0#", ERROR_IN=w151) -> (ERROR_OUT=w154)
            }
            frame "2000" {
              call "Read_Write_VISA.gvi"(VISA_IN=w147, CMD="@DO 39 0#", ERROR_IN=w151) -> (ERROR_OUT=w154)
            }
            frame "4000", Default {
              call "Read_Write_VISA.gvi"(VISA_IN=w147, CMD="@DO 40 0#", ERROR_IN=w151) -> (ERROR_OUT=w154)
            }
          }
          Is Empty String Or Path(string/path=w152) -> w155
          next s5 = w152
          stop if w155
        }
        # Connect Load
        call "Read_Write_VISA.gvi"(VISA_IN=w147, CMD="@DO 42 0#", ERROR_IN=w154) -> (ERROR_OUT=w12)
        w13 = s1
        w14 = default
        w15 = s2
      }
      frame "Reset Resistance" {
        Property Node(instance in=s3) -> ("VISA Resource"=w156, instance out=w16)
        # Сопротивление в начальное положение
        w157 = ["@DO 42 1#", "@DO 34 1#", "@DO 35 1#", "@DO 36 1#", "@DO 37 1#", "@DO 38 1#", "@DO 39 1#", "@DO 40 1#", "@DO 41 1#", "@DO 43 1#", "@DO 44 1#", "@DO 45 1#", "@DO 46 1#", "@DO 47 1#", "@DO 48 1#", "@DO 49 1#"]
        call "CMD_Iteration.gvi"(VISA_IN=w156, ARRAY_IN=w157, ERROR_IN=w11) -> (ERROR_OUT=w12)
        w13 = s1
        w14 = default
        w15 = s2
      }
      frame "Watchdog" {
        Property Node(instance in=s3) -> ("Physical Channel"=w158, "VISA Resource"=w159, "tag"=w160, instance out=w16)
        call "DAQmx Read (Analog 2D DBL NChan NSamp).gvi"(task in=w158, number of samples per channel=1) -> (data=w161)
        Array Index(array=w161) -> (out0[2, 0]=w162)
        Multiply(w162, 4) -> w163
        Multiply(w163, $"Voltage coeff") -> w164
        $V_real <- w164
        call "Read_Write_VISA.gvi"(VISA_IN=w159, CMD="@LUX 10 1#", ERROR_IN=w11) -> (OUTPUT=w165, TAG=w166, ERROR_OUT=w167)
        $LUX_2 <- w166
        call "Read_Write_VISA.gvi"(VISA_IN=w165, CMD="@TEMP 12 0#", ERROR_IN=w167) -> (TAG=w168, ERROR_OUT=w169)
        $TEMP_2 <- w168
        Array Index(array=w161) -> (out0[6, 0]=w170)
        Multiply(w170, $"Current coeff") -> w171
        $Current_real <- w171
        Property Node(instance in=w168) -> ("DATA"=w172, "Timestamp"=w173)
        call "Write Tag (String).gvi"(tag in=w160, value=w172, time stamp=w173, error in=w169) -> (error out=w174)
        call "DAQmx Read (Analog 1D Wfm NChan NSamp).gvi"(task in=w158, error in=w174, number of samples per channel=1) -> (error out=w175, data=w176)
        $Chart <- w176
        call "Enqueue Message (Single).gvi"(message queue in=w8, message="Wait For Event", error in=w175) -> (error out=w12)
        w13 = s1
        w14 = default
        w15 = s2
      }
      frame "Update Display" {
        w12 = w11
        w13 = s1
        w14 = default
        w15 = s2
        w16 = s3
      }
      frame "Error" {
        Variant To Data(error in (no error)=w11, type=no error, variant=w10) -> (data=w177, error out=w12)
        # #CodeRecommended - If you ever change the name of this "Error" message, you'll need to update the name in the Check Loop Error.vi as well.
        call "Display Error.gvi"(error in=w177)
        w13 = s1
        w14 = default
        w15 = s2
        w16 = s3
      }
      frame "Exit" {
        Property Node(instance in=s3) -> ("VISA Resource"=w178, "Physical Channel"=w179, "tag"=w180, "configuration"=w181)
        call "Close (Instr).gvi"(session in=w178)
        call "DAQmx Stop Task.gvi"(task in=w179)
        call "Close Tag (Single).gvi"(tag=w180)
        call "Close Configuration.gvi"(configuration=w181)
        Release Queue(error in=w11, queue=w8) -> (error out=w182)
        disable {
          frame Enabled {
            w183 = FALSE
            w14 = FALSE
          }
          frame Disabled {
            w183 = TRUE
            w14 = TRUE
          }
        }
        Generate User Event(event data=w183, user event=w3) -> (error out=w184)
        Merge Errors(w184, w182) -> (error out=w12)
        w13 = s1
        w15 = s2
        w16 = default
      }
      frame Default {
        w185 = "The invalid message string \"%s\" was received in the Message Handling Loop."
        Format Into String(formatString=w185, w9) -> w186
        call "Build Error Cluster.gvi"(code=1, description=w186) -> (error out=w12)
        w13 = s1
        w14 = default
        w15 = s2
        w16 = s3
      }
    }
    call "Error Handler - Message Handling Loop.gvi"(message queue in=w8, error in=w12) -> (dup error in=w187)
    next s1 = w13
    next s2 = w15
    next s3 = w16
    stop if w14
  }
  Register For Events("Stop Event"=w3) -> (event registration refnum out=w188)
  s6 = w188  # shift register
  while {
    event (dynamic events = s6) {
      on "TEMP Button" Value changed {
        call "Enqueue Message (Single).gvi"(message queue in=w6, message="Get Temperature") -> (message queue out=w191, error out=w190)
        w189 = default
      }
      on "LUX Button" Value changed {
        call "Enqueue Message (Single).gvi"(message queue in=w6, message="Get Brightness") -> (message queue out=w191, error out=w190)
        w189 = default
      }
      on "Exit" Value changed {
        call "Enqueue Message (Single).gvi"(priority message=TRUE, message queue in=w6, message="Exit") -> (message queue out=w191, error out=w190)
        w189 = default
      }
      on dynamic event 0 {
        $Display <- "\"Exit\" button pressed"
        disable {
          frame Enabled {
            w189 = FALSE
          }
          frame Disabled {
            w189 = TRUE
          }
        }
        w190 = default
        w191 = w6
      }
      on "Window" Close? {
        call "Enqueue Message (Single).gvi"(priority message=TRUE, message queue in=w6, message="Exit") -> (message queue out=w191)
        Event Filter("Discard?"=TRUE)
        w189 = default
        w190 = default
      }
      on "Initialize VISA" Value changed {
        call "Enqueue Message (Single).gvi"(message queue in=w6, message="Initialize VISA") -> (message queue out=w191, error out=w190)
        w189 = default
      }
      on "CMD Button" Value changed {
        call "Enqueue Message (Single).gvi"(message queue in=w6, message="Send CMD") -> (message queue out=w191, error out=w190)
        w189 = default
      }
      on "Reset CVM Button" Value changed {
        call "Enqueue Message (Single).gvi"(message queue in=w6, message="Reset CVM") -> (message queue out=w191, error out=w190)
        w189 = default
      }
      on "Initialize AI" Value changed {
        call "Enqueue Message (Single).gvi"(message queue in=w6, message="Initialize AI") -> (message queue out=w191, error out=w190)
        w189 = default
      }
      on "PV Config Button" Value changed {
        call "Enqueue Message (Single).gvi"(message queue in=w6, message="PV Config", message data=$"PV Config Selector") -> (message queue out=w191, error out=w190)
        w189 = default
      }
      on "Set PV Angle Button" Value changed {
        call "Enqueue Message (Single).gvi"(message queue in=w6, message="Set PV Angle", message data=$"PV Angle") -> (message queue out=w191, error out=w190)
        w189 = default
      }
      on "IR Thermometer Config Button" Value changed {
        call "Enqueue Message (Single).gvi"(message queue in=w6, message="IR Thermometer", message data=$"IR Thermometer Selector") -> (message queue out=w191, error out=w190)
        w189 = default
      }
      on "Fans Button" Value changed {
        call "Enqueue Message (Single).gvi"(message queue in=w6, message="Fans Control", message data=$"Fans Selector") -> (message queue out=w191, error out=w190)
        w189 = default
      }
      on "Brightness Config Button" Value changed {
        call "Enqueue Message (Single).gvi"(message queue in=w6, message="Brightness Config", message data=$Brightness) -> (message queue out=w191, error out=w190)
        w189 = default
      }
      on "Optic Filter Config Button" Value changed {
        call "Enqueue Message (Single).gvi"(message queue in=w6, message="Optic Filter Config", message data=$"Optic Filter Selector") -> (message queue out=w191, error out=w190)
        w189 = default
      }
      on "Prepare CVM Button" Value changed {
        call "Enqueue Message (Single).gvi"(message queue in=w6, message="Prepare CVM") -> (message queue out=w191, error out=w190)
        w189 = default
      }
      on "Set Resistance Button" Value changed {
        call "Enqueue Message (Single).gvi"(message queue in=w6, message="Set Resistance", message data=$"Resistance String") -> (message queue out=w191, error out=w190)
        w189 = default
      }
      on "Reset Resistance Button" Value changed {
        call "Enqueue Message (Single).gvi"(message queue in=w6, message="Reset Resistance") -> (message queue out=w191, error out=w190)
        w189 = default
      }
      on "VAC Button" Value changed {
        Get Current Time() -> (current time=w192)
        call "Enqueue Message (Single).gvi"(message queue in=w6, message="VAC", message data=w192) -> (message queue out=w191)
        $"VAC Load Counter" <- 0
        w189 = default
        w190 = default
      }
    }
    call "Error Handler - Event Handling Loop.gvi"(message queue in=w191, error in=w190) -> (dup error in=w193)
    stop if w189
  }
  Unregister For Events(error in=w193, event registration refnum=s6) -> (error out=w194)
  Merge Errors(w194, w187) -> (error out=w195)
  Destroy User Event(error in=w195, user event=w3)
  disable {
    frame Enabled { }
    frame Disabled { }
  }
  $"error out" <- w195
  disable {
    frame Enabled { }
    frame Disabled {
      call "Initialize.gvi"(device name="cam0") -> (session out=w196, error out=w197)
      call "Configure Grab.gvi"(session in=w196, error in=w197) -> (session out=w198, error out=w199)
      call "Create Image.gvi"(image name="image_1") -> (new image=w200)
      while {
        call "Grab.gvi"(session in=w198, error in=w199, image in=w200) -> (session out=w201, error out=w202, image out=w203)
        $Image <- w203
        stop if $Stop
      }
      call "Close.gvi"(session=w201, error in=w202)
    }
  }
  disable {
    frame Enabled { }
    frame Disabled {
      call "DAQmx Create Channel (AI-Voltage-Basic).gvi"(physical channels="Dev1/ai3,Dev1/ai1,Dev1/ai0,Dev1/ai7", units="Volts"(10348), measurement range="ValueRange.gtype" {"maximum value"=10, "minimum value"=0}, input terminal configuration="Default"(-1)) -> (task out=w204, error out=w205)
      while {
        call "DAQmx Read (Analog 1D Wfm NChan NSamp).gvi"(task in=w204, error in=w205, number of samples per channel=1) -> (data=w206)
        $Chart_2 <- w206
        Wait Until Next Multiple(multiple to wait=50)
        stop if $stop_2
      }
    }
  }
